# Grasshopper definition Test_miq.gh (Grasshopper 1.0.7)
# plug-ins: CGeomGH Info, IguanaMesh

number_slider = Slider(2.48, range=0..10)
crv = Curve(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)
ilineartria = ILinearTria(
    MinimumSize=number_slider,
    MaximunSize=number_slider,
    CurvatureAdapt=False,
    MininimumElements=6,
    SmoothingSteps=10,
    RightAngles=False,
    Massive_Refinement=False)
patch = Patch(Curves=crv, Spans=20, Flexibility=1, Trim=True)
number_slider_2 = Slider(98, range=1..100)
ipatchsrf = IPatchSurface(Surface=patch, ISettings=ilineartria)  # -> IMesh, Entities, Info
ideconstructmesh = IDeconstructMesh(IMesh=ipatchsrf.IMesh)  # -> IVertices, VertexKeys, IElements, IKeysE, SiblingHalfFacets, VertexToHalfFacet
perfaceprincipalcurvatures = PerFacePrincipalCurvatures(Mesh=ipatchsrf.IMesh)  # -> Val1, Val2, Dir1, Dir2
lng = ListLength(List=ideconstructmesh.IElements)
series = Series(Start=0, Step=1, Count=lng)
nrosy = NRosy(Mesh=ipatchsrf.IMesh, FaceIdx=series, Vector=perfaceprincipalcurvatures.Dir1)  # -> X1, X2, B, Singularity
nickname = SeamlessIntegerGH(Mesh=ipatchsrf.IMesh, X1=nrosy.X1, X2=nrosy.X2, Grad=Slider(35.27, range=0..100), Stiffness=5, Round=False, Iterations=0)  # -> UV, FUV
vdis = VectorDisplay(Anchor=nrosy.B, Vector=nrosy.X1)
vdis_2 = VectorDisplay(Anchor=nrosy.B, Vector=nrosy.X2)
qmeshextr = QuadMeshExtraction(Mesh=ipatchsrf.IMesh, UV=nickname.UV, FUV=nickname.FUV)
