# Grasshopper definition cgeom_geodesicPaths.gh (Grasshopper 1.0.8)
# plug-ins: CGeomGH Info

mesh = Mesh(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)
pi = Pi(Factor=Slider(0.3, range=0..0.5))
harmonic = Harmonic(Mesh=mesh, UCount=Slider(50, range=10..50), VCount=Slider(50, range=10..50), Angle=pi)  # -> Disk, Texture2D, Texture3D
bang = ExplodeTree(Data=harmonic.Texture2D)  # -> Branch0, Branch1
bang_2 = ExplodeTree(Data=harmonic.Texture3D)  # -> Branch0, Branch1
curvatures = Curvatures(Mesh=mesh, Alpha=Slider(1, range=0..1), cmapIdx=4, metricsIdx=1)  # -> CMesh, Data
preview = CustomPreview(Geometry=harmonic.Disk, Material=ColourSwatch(SwatchColor=RGBA(140, 139, 139, 85)))
preview_2 = CustomPreview(Geometry=[bang.Branch0, bang_2.Branch0], Material=ColourSwatch(SwatchColor=RGB(51, 0, 255)))
preview_3 = CustomPreview(Geometry=[bang.Branch1, bang_2.Branch1], Material=ColourSwatch(SwatchColor=RGB(85, 255, 0)))
