# Grasshopper definition cgeom_asymptoticNetwork.gh (Grasshopper 1.0.7)
# plug-ins: IguanaMesh, CGeomGH Info

number_slider = Slider(1, range=0..10)
crv = Curve([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])
loft = Loft(Curves=crv, Options={Adjust=False, Closed=False, LoftEnds=0, LoftSimp=0, LoftType=0, Rebuild=10, Refit=0.01})
ilineartria = ILinearTria(
    MinimumSize=number_slider,
    MaximunSize=number_slider,
    CurvatureAdapt=False,
    MininimumElements=6,
    SmoothingSteps=10,
    RightAngles=False,
    Massive_Refinement=False)
ipatchsrf = IPatchSurface(Surface=loft, ISettings=ilineartria)  # -> IMesh, Entities, Info
inakedvertices = INakedVertices(IMesh=ipatchsrf.IMesh)
pt = Point(inakedvertices)
laplaciansmoothing = LaplacianSmoothing(Mesh=ipatchsrf.IMesh, Anchors=pt, Tolerance=0.001, Iterations=Slider(2, range=0..5))
demesh = DeconstructMesh(Mesh=laplaciansmoothing)  # -> Vertices, Faces, Colours, Normals

number_slider_2 = Slider(0.48, range=0..1)
# Per face asymptotic directions
fasymptoticdirections = PerFaceAsymptoticDirections(Mesh=laplaciansmoothing)  # -> Dir1, Dir2
unit = UnitVector(Vector=fasymptoticdirections.Dir1)
unit_2 = UnitVector(Vector=fasymptoticdirections.Dir2)
multiplication = Multiplication(A=unit, B=number_slider_2)
multiplication_2 = Multiplication(A=unit_2, B=number_slider_2)
vdisex = VectorDisplayEx(Vector=multiplication, Colour=RGB(0, 0, 0), Width=2)
vdisex_2 = VectorDisplayEx(Vector=multiplication_2, Colour=RGB(0, 0, 0), Width=2)

lng = ListLength(List=demesh.Faces)
faceb = FaceBoundaries(Mesh=laplaciansmoothing)
dom = ConstructDomain(DomainStart=0, DomainEnd=lng)
random = Random(Range=dom, Number=Slider(50, range=0..50), Seed=2)
int = Integer(random)
item = ListItem(List=faceb, Index=int, Wrap=True)
item_2 = ListItem(List=fasymptoticdirections.Dir1, Index=int, Wrap=True)
item_3 = ListItem(List=fasymptoticdirections.Dir2, Index=int, Wrap=True)
boundary = BoundarySurfaces(Edges=item)
preview = CustomPreview(
    Geometry=boundary,
    Material={diffuse=RGB(228, 178, 227), emission=RGB(68, 53, 68), shine=0.5, specular=RGB(255, 254, 254), transparency=0})
nrosy = NRosy(Mesh=laplaciansmoothing, B=int, Bc1=item_2, Bc2=item_3)
sigparam = SIGParam(Mesh=laplaciansmoothing, NRosy=nrosy, GradSize=Slider(40.57, range=0..100), Stiffness=5, Round=False, Iterations=1)  # -> UV, FUV
qmesh = QuadMesh(Mesh=laplaciansmoothing, UV=sigparam.UV, FUV=sigparam.FUV)
